# Grasshopper definition test.gh (Grasshopper 1.0.7)
# plug-ins: semio

mime = Mime({".stl": "model/stl", ".obj": "model/obj", ".glb": "model/gltf-binary", ".gltf": "model/gltf+json", ".3dm": "model/vnd.3dm", ".speckle": "model/vnd.speckle+json", ".png": "image/png", ".jpg": "image/jpeg", ".jpeg": "image/jpeg", ".svg": "image/svg+xml", ".pdf": "application/pdf", ".zip": "application/zip", ".json": "application/json", ".csv": "text/csv", ".txt": "text/plain"}, selected=".glb")
panel = Panel("""plan
floor
ground""")
rep = ModelRepresentation(Url="file1", Mime=mime, Lod="1to200", Tags=panel)  # -> Representation, Url, Mime, Lod, Tags
rep_2 = ModelRepresentation()  # -> Representation, Url, Mime, Lod, Tags
merge = Merge(Data1=rep.Representation, Data2=rep_2.Representation)
typ = ModelType(Name="Capsule", Description="A Capsule.", Icon="📦", Representations=merge)  # -> Type, Name, Description, Icon, Variant, Unit, Representations
trim = TrimTree(Tree=typ.Representations, Depth=1)
rep_3 = ModelRepresentation(Representation=trim)  # -> Representation, Url, Mime, Lod, Tags
panel_2 = Panel(rep_3.Representation)
